# Dynamo graph Design Scirpt Bimgia.dyn (Dynamo 2.17.0.3472)

# group: Design Scirpt
boolean = BoolSelector(false)
python_script = Python(IN[0]=boolean)  # CPython3
# ---------- python_script.python (3 lines) ----------
f = open(r"D:\030-Dynamo\Tool\Training-Dynamo-2024\DesignScript.py", "r")

OUT = f.read()
# ----------------------------------------
python_script_from_string = PythonStringNode(script=python_script)  # CPython3; unwired: IN[0]
